# Grasshopper definition Studio.gh (Grasshopper 1.0.7)
# plug-ins: Pufferfish, TT Toolbox

# ---- group: RH_IN:Position
number_slider = Slider(0, range=0..100)

# ----
random = Random(Range=Domain(0, 1), Number=1, Seed=expr("x*2", number_slider))
random_2 = Random(Range=Domain(0, 1), Number=1, Seed=number_slider)
construct_point = ConstructPoint(XCoordinate=random_2, YCoordinate=random, ZCoordinate=0)

# ----
# Terrain & Surface
md_slider = MDSlider(
    SliderMode=0,
    slider_value=Point(0.2041953482, 0.269661508, 0.5),
    x_domain=Domain(0, 1),
    y_domain=Domain(0, 1),
    z_domain=Domain(0, 1))
curve = Curve([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])
patch = Patch(Curves=curve, Spans=20, Flexibility=1, Trim=True)
evaluate_surface = EvaluateSurface(Surface=reparameterize(patch), Point=construct_point)  # -> Point, Normal, UDirection, VDirection, Frame
point = Point(evaluate_surface.Point)

# ---- group: RH_OUT:Surface
curve_2 = Curve(curve)

# ----
# Sections from Maya
# Torus
# Mesh & Torus
boolean_toggle = BooleanToggle(False)

# ---- group: RH_IN:Show Terrain Surface
boolean = Boolean(True)

# ----
point_2 = Point(Point(1, 0, 0))
stream_filter = StreamFilter(Gate=boolean, Stream1=patch)
angle = Angle(VectorA=evaluate_surface.Normal, VectorB=point_2)  # -> Angle, Reflex

# ---- group: RH_OUT:Terrain
surface = Surface(stream_filter)

# ----
expression = Expression(x=angle.Angle, Expression="x*180/pi")
panel = Panel(expression)
P = Plane(evaluate_surface.Point)
panel_2 = Panel(expression)
radius_of_the_torus = Slider(60, range=10..100)
larger_than = LargerThan(FirstNumber=panel_2, SecondNumber="90")  # -> LargerThan, OrEqualTo
circle = Circle(Plane=P, Radius=radius_of_the_torus)
rotate = Rotate(Geometry=circle, Angle=3.141592654, Plane=P)  # -> Geometry, Transform
stream_filter_2 = StreamFilter(Gate=larger_than.LargerThan, Stream0=circle, Stream1=rotate.Geometry)
divide_curve = DivideCurve(Curve=reparameterize(stream_filter_2), Count=8, Kinks=False)  # -> Points, Tangents, Parameters
pipe = Pipe(Curve=stream_filter_2, Radius=Slider(4, range=0..10), Caps=0)
shatter = Shatter(Curve=reparameterize(stream_filter_2), Parameters=divide_curve.Parameters)
# Torus
list_item = ListItem(List=shatter, Index="2", Wrap=True)  # -> Item, Item1, Item2, Item3
join_curves = JoinCurves(Curves=[list_item.Item1, list_item.Item, list_item.Item2, list_item.Item3], Preserve=False)
list_item_2 = ListItem(List=shatter, Index="-1", Wrap=True)  # -> Item1, Item, Item1_2, Item2
perp_frames = PerpFrames(Curve=join_curves, Count=Slider(10, range=0..10), Align=True)  # -> Frames, Parameters
join_curves_2 = JoinCurves(Curves=[list_item_2.Item, list_item_2.Item1_2], Preserve=False)
circle_2 = Circle(Plane=PlaneXY(0, 0, 0), Radius=Slider(6, range=0..10))
orient = Orient(Geometry=circle_2, Source=PlaneXY(0, 0, 0), Target=perp_frames.Frames)  # -> Geometry, Transform
perp_frames_2 = PerpFrames(Curve=join_curves_2, Count=2, Align=True)  # -> Frames, Parameters
number_slider_2 = Slider(13, range=0..20)
number_slider_3 = Slider(2, range=0..3)
list_item_3 = ListItem(List=perp_frames_2.Frames, Index=0, Wrap=True)  # -> Item, Item1, Item2
scale_nu = ScaleNU(Geometry=circle_2, Plane=PlaneXY(0, 0, 0), ScaleX=Slider(5, range=0..10), ScaleY=Slider(2, range=0..10), ScaleZ=1)  # -> Geometry, Transform
scale_nu_2 = ScaleNU(Geometry=circle_2, Plane=PlaneXY(0, 0, 0), ScaleX=Slider(1.8, range=0..10), ScaleY=Slider(3.2, range=0..10), ScaleZ=1)  # -> Geometry, Transform
rebuild_curve = RebuildCurve(Curve=scale_nu.Geometry, Count=number_slider_2, Degree=number_slider_3, EndTangents=False)
rebuild_curve_2 = RebuildCurve(Curve=scale_nu_2.Geometry, Count=number_slider_2, Degree=number_slider_3, EndTangents=False)
area = Area(Geometry=rebuild_curve)  # -> Area, Centroid
area_2 = Area(Geometry=rebuild_curve_2)  # -> Area, Centroid
orient_2 = Orient(Geometry=rebuild_curve_2, Source=area_2.Centroid, Target=list_item_3.Item2)  # -> Geometry, Transform
unit_z = UnitZ(Factor=Slider(36, range=0..100))
number_slider_4 = Slider(100, range=0..100)
orient_3 = Orient(Geometry=rebuild_curve_2, Source=area_2.Centroid, Target=list_item_3.Item)  # -> Geometry, Transform
orient_4 = Orient(Geometry=rebuild_curve, Source=area.Centroid, Target=list_item_3.Item1)  # -> Geometry, Transform
random_3 = Random(Range=Domain(0, 1), Number=1, Seed=expr("x*2", number_slider_4))
random_4 = Random(Range=Domain(0, 1), Number=1, Seed=number_slider_4)
move = Move(Geometry=orient_4.Geometry, Motion=unit_z)  # -> Geometry, Transform
remap_numbers = RemapNumbers(Value=random_4, Source=Domain(0, 1), Target=Domain(-30, 30))  # -> Mapped, Clipped
remap_numbers_2 = RemapNumbers(Value=random_3, Source=Domain(0, 1), Target=Domain(-30, 30))  # -> Mapped, Clipped
number_slider_5 = Slider(13, range=0..100, expression="-x")
point_on_curve = PointOnCurve(move.Geometry, parameter=0.746)
unit_z_2 = UnitZ(Factor=number_slider_5)
unit_z_3 = UnitZ(Factor=number_slider_5)
area_3 = Area(Geometry=orient_2.Geometry)  # -> Area, Centroid
area_4 = Area(Geometry=orient_3.Geometry)  # -> Area, Centroid
move_2 = Move(Geometry=orient_3.Geometry, Motion=unit_z_2)  # -> Geometry, Transform
move_3 = Move(Geometry=orient_2.Geometry, Motion=unit_z_3)  # -> Geometry, Transform
project_point = ProjectPoint(Point=point_on_curve, Direction=Vector(0, 0, -1), Geometry=patch)  # -> Point, Index
addition = Addition(A=area_4.Area, B=area_3.Area)
divide_curve_2 = DivideCurve(Curve=move_2.Geometry, Count=Slider(20, range=0..100), Kinks=False)  # -> Points, Tangents, Parameters
panel_3 = Panel(addition)
line_sdl = LineSDL(Start=project_point.Point, Direction=Vector(0, 0, 1), Length=Slider(10, range=0..100))
divide_curve_3 = DivideCurve(Curve=move_3.Geometry, Count=Slider(20, range=0..100), Kinks=False)  # -> Points, Tangents, Parameters
end_points = EndPoints(Curve=line_sdl)  # -> Start, End
point_3 = Point(end_points.End)
project = Project(Geometry=patch, Plane=PlaneXY(0, 0, 0))  # -> Geometry, Transform
brep_edges = BrepEdges(Brep=project.Geometry)  # -> Naked, Interior, NonManifold
brep_edges_2 = BrepEdges(Brep=patch)  # -> Naked, Interior, NonManifold
join_curves_3 = JoinCurves(Curves=brep_edges.Naked, Preserve=False)
join_curves_4 = JoinCurves(Curves=brep_edges_2.Naked, Preserve=False)
loft = Loft(
    Curves=[join_curves_3, join_curves_4],
    Options={Adjust=False, Closed=False, LoftEnds=0, LoftSimp=0, LoftType=0, Rebuild=10, Refit=0.01})
# Distance Between RIBS
# Ribs
brep_join = BrepJoin(Breps=flatten([project.Geometry, loft, patch]))  # -> Breps, Closed
point_in_brep = PointInBrep(Brep=brep_join.Breps, Point=divide_curve_2.Points, Strict=False)
dispatch = Dispatch(List=divide_curve_2.Points, DispatchPattern=point_in_brep)  # -> ListA, ListB
point_in_brep_2 = PointInBrep(Brep=brep_join.Breps, Point=divide_curve_3.Points, Strict=False)
list_length = ListLength(List=dispatch.ListA)
list_length_2 = ListLength(List=dispatch.ListB)
dispatch_2 = Dispatch(List=divide_curve_3.Points, DispatchPattern=point_in_brep_2)  # -> ListA, ListB
division = Division(A=list_length_2, B=list_length)
list_length_3 = ListLength(List=dispatch_2.ListA)
list_length_4 = ListLength(List=dispatch_2.ListB)
scale_nu_3 = ScaleNU(Geometry=orient_3.Geometry, Plane=list_item_3.Item, ScaleX=1, ScaleY=division, ScaleZ=1)  # -> Geometry, Transform
division_2 = Division(A=list_length_4, B=list_length_3)
area_5 = Area(Geometry=scale_nu_3.Geometry)  # -> Area, Centroid
scale_nu_4 = ScaleNU(Geometry=move_3.Geometry, Plane=list_item_3.Item2, ScaleX=1, ScaleY=division_2, ScaleZ=division_2)  # -> Geometry, Transform
area_6 = Area(Geometry=scale_nu_4.Geometry)  # -> Area, Centroid
addition_2 = Addition(A=area_5.Area, B=area_6.Area)
panel_4 = Panel(addition_2)
division_3 = Division(A=area_5.Area, B=panel_4)
division_4 = Division(A=area_6.Area, B=panel_4)
multiplication = Multiplication(A=panel_3, B=division_3)
multiplication_2 = Multiplication(A=panel_3, B=division_4)
scale_to_area = ScaleToArea(
    Geometry=scale_nu_3.Geometry,
    Plane=list_item_3.Item,
    Area=multiplication,
    FactorX=1,
    FactorY=Slider(0.5, range=0..1),
    FactorZ=1)  # -> Scaled, Transform
move_to_point = MoveToPoint(Geometry=move.Geometry, PointA=point_on_curve, PointB=point_3)  # -> Moved, Vector, Transform
scale_to_area_2 = ScaleToArea(Geometry=scale_nu_4.Geometry, Plane=list_item_3.Item, Area=multiplication_2, FactorX=1, FactorY=1, FactorZ=1)  # -> Scaled, Transform

# ---- group: parametrized according to terrain
merge = Merge(Data1=orient.Geometry, Data2=move_to_point.Moved, Data3=scale_to_area.Scaled, Data4=scale_to_area_2.Scaled)  # -> flatten(Result)

# ----
arc = Arc(Plane=P, Radius=radius_of_the_torus, Angle=Domain(0, 6.283185307))  # -> Arc, Length
number_slider_6 = Slider(200, range=0..1000)
sort_curves_along_crv = SortCurvesAlongCrv(Curves=merge, GuideCrv=arc.Arc, CrvParam=0.5)  # -> SortedCurves, CurveIndex
range = Range(Domain=Domain(0, 1), Steps=Slider(100, range=0..100, expression="x*2"))
tween_through_curves_along_curve = TweenThroughCurvesAlongCurve(
    Curves=sort_curves_along_crv.SortedCurves,
    Guide1=arc.Arc,
    Factor=range,
    Normalized=True,
    Equalized=False,
    Refit=0,
    PointSample=0)
c_script = CSharpScript(crv=tween_through_curves_along_curve, color=ColourSwatch(SwatchColor=RGB(255, 255, 0)))  # -> out, A; inputs crv: Curve, color: Color
# ---------- c_script: C# ----------
    var c = color.R + "," + color.G + "," + color.B;
    crv.SetUserString("color", c);
    A = crv;
# ---------- end c_script ----------

# ---- group: RH_OUT:crvs
crv = Curve(c_script.A)
