# Grasshopper definition Voronoi_Table.gh (Grasshopper 1.0.7)

# ---- group: RH_IN:distance
number_slider = Slider(24, range=0..100)

# ---- group: RH_IN:radius
radius = Slider(20, range=5..20)

# ---- group: RH_IN:height
height = Slider(14, range=2..20)

# ---- group: RH_IN:explode
explode = Boolean(False)

# ----
circle = Circle(Plane=PlaneXY(0, 0, 0), Radius=radius)
unit_z = UnitZ(Factor=height)
extrude = Extrude(Base=circle, Direction=unit_z)
cap_holes = CapHoles(Brep=extrude)
area = Area(Geometry=cap_holes)  # -> Area, Centroid
deconstruct_brep = DeconstructBrep(Brep=cap_holes)  # -> Faces, Edges, Vertices
list_item = ListItem(List=deconstruct_brep.Faces, Index=0, Wrap=True)  # -> Item, Item1
scale = Scale(Geometry=cap_holes, Center=area.Centroid, Factor=Slider(0.75, range=0..1))  # -> Geometry, Transform
unit_z_2 = UnitZ(Factor=1)
populate_3d = Populate3D(Region=cap_holes, Count=100, Seed=1)
extrude_2 = Extrude(Base=list_item.Item1, Direction=unit_z_2)
voronoi_3d = Voronoi3D(Points=populate_3d)  # -> Cells, Boundary

# ---- group: RH_OUT:tableTop
mesh = Mesh(extrude_2)

# ----
point_in_brep = PointInBrep(Brep=scale.Geometry, Point=populate_3d, Strict=False)
dispatch = Dispatch(List=voronoi_3d.Cells, DispatchPattern=point_in_brep)  # -> ListA, ListB
brep = Brep(dispatch.ListA)
deconstruct_brep_2 = DeconstructBrep(Brep=brep)  # -> Faces, Edges, Vertices
deconstruct_brep_3 = DeconstructBrep(Brep=deconstruct_brep_2.Faces)  # -> Faces, Edges, Vertices
area_2 = Area(Geometry=deconstruct_brep_3.Faces)  # -> Area, Centroid
factor = Slider(0.9, range=0..1)
scale_2 = Scale(Geometry=deconstruct_brep_3.Faces, Center=area_2.Centroid, Factor=factor)  # -> Geometry, Transform
deconstruct_brep_4 = DeconstructBrep(Brep=scale_2.Geometry)  # -> Faces, Edges, Vertices
join_curves = JoinCurves(Curves=deconstruct_brep_4.Edges, Preserve=False)  # -> simplify(Curves)
join_curves_2 = JoinCurves(Curves=deconstruct_brep_3.Edges, Preserve=False)  # -> simplify(Curves)
explode_2 = Explode(Curve=join_curves_2, Recursive=True)  # -> Segments, Vertices
explode_3 = Explode(Curve=join_curves, Recursive=True)  # -> Segments, Vertices
end = EndPoints(Curve=graft(explode_2.Segments))  # -> Start, End
end_2 = EndPoints(Curve=graft(explode_3.Segments))  # -> Start, End
merge = Merge(Data1=end.Start, Data2=end.End, Data3=end_2.End, Data4=end_2.Start)
conmesh = ConstructMesh(Vertices=merge, Faces={A=0, B=1, C=2, D=3})
pshift = ShiftPaths(Data=simplify(conmesh), Offset=-2)
mjoin = MeshJoin(Meshes=pshift)  # -> flatten(Mesh)

# ---- group: RH_OUT:cells joined
mesh_2 = Mesh(flatten(mjoin))

# ----
bbox = BoundingBox(Content=mjoin, Plane=PlaneXY(0, 0, 0), UnionBox=True)  # -> Box, Box_2
mesh_3 = Mesh(mjoin)
volume = Volume(Geometry=bbox.Box)  # -> Volume, Centroid
area_3 = Area(Geometry=mesh_2)  # -> Area, Centroid
moveaway = MoveAwayFrom(Geometry=mjoin, Emitter=volume.Centroid, Distance=number_slider)  # -> Geometry, Transform
filter = StreamFilter(Gate=explode, Stream0=mesh_3, Stream1=moveaway.Geometry)
mesh_edges = MeshEdges(Mesh=filter)  # -> NakedEdges, InteriorEdges, NonManifoldEdges

# ---- group: RH_OUT:cells
mesh_4 = Mesh(flatten(filter))

# ----
area_4 = Area(Geometry=mesh_4)  # -> Area, Centroid
line = Line(StartPoint=area_3.Centroid, EndPoint=area_4.Centroid)

# ---- group: RH_OUT:cells lines
line_2 = Line(flatten([mesh_edges.InteriorEdges, mesh_edges.NakedEdges]))

# ---- group: RH_OUT:line
line_3 = Line(line)

# ---- group: RH_OUT:outside point
point = Point(area_4.Centroid)

# ----
sphere = Sphere(Base=point, Radius=1)
